# Grasshopper definition carteros_5.7_share.gh (Grasshopper 1.0.7)
# plug-ins: OpenNest, Pufferfish, treesloth01

crv = Curve(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)
crv_2 = Curve([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])
# GENERACION GEOMETRIA BALDAS
crv_3 = Curve([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])
crv_4 = Curve([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])
tolerancia_pared = Slider(25, range=0..100)
altura_peines = Slider(450, range=0..1000)
tolerancia_pared_2 = Slider(25, range=0..100)
altura_mueble = Slider(2400, range=0..10000)
# GENERACION GEOMETRIA MONTANTES
panel = Panel("1")
popgeo = PopulateGeometry(Geometry=crv_4, Count="1", Seed=1)
popgeo_2 = PopulateGeometry(Geometry=crv_3, Count="1", Seed=1)
# GENERACION PEINES
crv_5 = Curve([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])
altura_mueble_2 = Slider(2400, range=0..10000)
offset = OffsetCurve(Curve=crv, Distance=expr("-x", tolerancia_pared), Plane=PlaneXY(0, 0, 0), Corners=1)
popgeo_3 = PopulateGeometry(Geometry=crv_2, Count=panel, Seed=1)
popgeo_4 = PopulateGeometry(Geometry=crv_4, Count="1", Seed=1)
pdecon = Deconstruct(Point=popgeo)  # -> XComponent, YComponent, flatten(ZComponent)
pdecon_2 = Deconstruct(Point=popgeo_2)  # -> XComponent, YComponent, flatten(ZComponent)
pdecon_3 = Deconstruct(Point=popgeo_3)  # -> XComponent, YComponent, flatten(ZComponent)
pdecon_4 = Deconstruct(Point=popgeo_4)  # -> XComponent, YComponent, flatten(ZComponent)
Z = UnitZ(Factor=altura_mueble)
offset_2 = OffsetCurve(Curve=crv, Distance=expr("-x", tolerancia_pared_2), Plane=PlaneXY(0, 0, 0), Corners=1)
sort = SortList(Keys=pdecon_2.ZComponent, ValuesA=crv_3)  # -> Keys, ValuesA
sort_2 = SortList(Keys=pdecon.ZComponent, ValuesA=crv_4)  # -> Keys, ValuesA
extr = Extrude(Base=offset, Direction=Z)
sort_3 = SortList(Keys=pdecon_3.ZComponent, ValuesA=crv_2)  # -> Keys, ValuesA
sort_4 = SortList(Keys=pdecon_4.ZComponent, ValuesA=crv_4)  # -> Keys, ValuesA
Z_2 = UnitZ(Factor=altura_mueble_2)
loft_opt = LoftOptions(Closed=False, Adjust="True", Rebuild=0, Refit=0, Type=0)
cap = CapHoles(Brep=extr)
loft_opt_2 = LoftOptions(Closed=False, Adjust="True", Rebuild=Slider(800, range=0..1000), Refit=0, Type=Slider(2, range=0..10))
extr_2 = Extrude(Base=offset_2, Direction=Z_2)
loft_opt_3 = LoftOptions(Closed=False, Adjust="True", Rebuild=0, Refit=Slider(10, range=0..10), Type=0)
loft_opt_4 = LoftOptions(Closed=False, Adjust="True", Rebuild=Slider(800, range=0..1000), Refit=0, Type=Slider(2, range=0..10))
loft = Loft(Curves=sort_2.ValuesA, Options=loft_opt)
loft_2 = Loft(Curves=sort.ValuesA, Options=loft_opt_2)
cap_2 = CapHoles(Brep=extr_2)
loft_3 = Loft(Curves=sort_4.ValuesA, Options=loft_opt_3)
loft_4 = Loft(Curves=sort_3.ValuesA, Options=loft_opt_4)
join = BrepJoin(Breps=[loft_2, loft])  # -> Breps, Closed
join_2 = BrepJoin(Breps=[loft_4, loft_3])  # -> Breps, Closed
capex = CapHolesEx(Brep=join.Breps)  # -> Brep, Caps, Solid
# SE HA HECHO BAKE DE ESA
# GEOMETRIA, OBTENIDO
# GENERATRICES VERTICALES Y
# VUELTO A USAR ESAS
# GENERATRICES PARA LA NUEVA
# FORMA. UNA GUARRADA
capex_2 = CapHolesEx(Brep=join_2.Breps)  # -> Brep, Caps, Solid
sdiff = SolidDifference(BrepsA=cap, BrepsB=capex.Brep)
sdiff_2 = SolidDifference(BrepsA=cap, BrepsB=sdiff)
geo = Geometry([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])
loft_opt_5 = LoftOptions(Closed=False, Adjust="True", Rebuild=Slider(200, range=0..1000), Refit=0, Type=Slider(2, range=0..10))
X = UnitX(Factor=Slider(6000, range=0..10000))
crv_6 = Curve(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)
# rellenar zona bajo bancada ventana
crv_7 = Curve(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)
srf = Surface(crv_6)
loft_5 = Loft(Curves=geo, Options=loft_opt_5)
srf_2 = Surface(crv_7)
move = Move(Geometry=sdiff_2, Motion=X)  # -> Geometry, Transform
cap_3 = CapHoles(Brep=loft_5)

# ----
# Creación baldas por altura
altura_primera_balda = Slider(500, range=0..1000)
number_slider = Slider(350, range=0..1000)

num = Number(altura_primera_balda)
subtraction = Subtraction(A=num, B=10)
Z_3 = UnitZ(Factor=subtraction)
extr_3 = Extrude(Base=crv_5, Direction=Z_3)
addition = Addition(A=altura_primera_balda, B=number_slider)
num_2 = Number(altura_primera_balda)
num_3 = Number(addition)
Z_4 = UnitZ(Factor=num_3)
Z_5 = UnitZ(Factor=num_2)
extr_4 = Extrude(Base=srf, Direction=Z_4)
extr_5 = Extrude(Base=srf_2, Direction=Z_5)
sint = SolidIntersection(BrepsA=extr_4, BrepsB=cap_2)
sint_2 = SolidIntersection(BrepsA=extr_5, BrepsB=cap_2)
sdiff_3 = SolidDifference(BrepsA=cap_2, BrepsB=cap_3)
sunion = SolidUnion(Breps=[sint_2, sdiff_3, sint])
random = Random(Range="420 to 650", Number=Slider(26, range=0..100), Seed=Slider(12, range=0..100))
ma = MassAddition(Input=random)  # -> Result, PartialResults
pt = ConstructPoint(XCoordinate="0", YCoordinate="0", ZCoordinate=altura_primera_balda)
num_4 = Number([648.9298193, 1146.750037, 1602.602109, 2050.081671, 2613.569938, 3044.071388, 3529.094098, 4055.443961, 4581.738497, 5162.443552, 5612.958255, 6225.212504, 6848.089013, 7431.981289, 7939.798426, 8480.460508, 9108.996677, 9629.124648, 10049.59058, 10690.63217, 11205.24367, 11807.42487, 12232.0162, 12703.71462, 13325.19704, 13801.42751])
X_2 = UnitX(Factor=Slider(6000, range=0..10000))
panel_2 = Panel("""0
-1
-2""")
contour = Contour(Shape=move.Geometry, Point=pt, Direction=Vector(0, 0, 1), Distance=number_slider)  # -> flatten(Contours)
num_5 = Number([648.9298193, 1146.750037, 1602.602109, 2050.081671, 2613.569938, 3044.071388, 3529.094098, 4055.443961, 4581.738497, 5162.443552, 5612.958255, 6225.212504, 6848.089013, 7551.981289, 8180.798426, 8640.460508, 9108.996677, 9629.124648, 10049.59058, 10690.63217, 11205.24367, 11807.42487, 12232.0162, 12703.71462, 13325.19704, 13801.42751])
move_2 = Move(Geometry=sunion, Motion=X_2)  # -> graft(Geometry), Transform
Y = UnitY(Factor=num_5)
panel_3 = Panel(num_5)
srf_3 = Surface(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)
eliminamos_primera_bandeja = CullIndex(List=contour, Indices=panel_2, Wrap=True)
move_3 = Move(Geometry=srf_3, Motion=Y)  # -> Geometry, Transform
srf_4 = Surface(eliminamos_primera_bandeja)
bbx = BrepBrep(BrepA=move_2.Geometry, BrepB=move_3.Geometry)  # -> flatten(Curves), Points
rgb = ColourRGB(Alpha=255, Red=Slider(64, range=0..255), Green=Slider(76, range=0..255), Blue=Slider(99, range=0..255))
boundary = BoundarySurfaces(Edges=bbx.Curves)
# filtrar retales pequeños
panel_4 = Panel("if(x<150000,1,0)")
preview = CustomPreview(Geometry=srf_4, Material=rgb)  # disabled
area = Area(Geometry=boundary)  # -> Area, Centroid
geo_2 = Geometry(simplify(boundary))
eval = Evaluate(F=panel_4, x=area.Area)  # -> simplify(r)
dispatch = Dispatch(List=geo_2, DispatchPattern=eval)  # -> ListA, ListB
# division por paneles
srf_5 = Surface(srf_4)
divisores_de_plancha_baldas = Surface(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)
splitmul = SplitBrepMultiple(Brep=srf_5, Cutters=divisores_de_plancha_baldas)
# recortar pasacables
geo_3 = Geometry([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])
panel_5 = Panel("""5
7
9
12
14""")
trim = TrimSolid(Shape=dispatch.ListB, Cutters=geo_3)  # -> flatten(Result)
crv_8 = Curve([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])
item = ListItem(List=move_3.Geometry, Index=panel_5, Wrap=False)
Z_6 = UnitZ(Factor=expr("-x", Slider(4236, range=0..10000)))
# dividir baldas anchas
Z_7 = UnitZ(Factor=Slider(3336, range=0..10000))
# baldas superiores
clscrv = CloseCurve(Curve=crv_8, CloseType=0, Bulge=0.5, Tolerance=0)  # -> Closed, R
move_4 = Move(Geometry=item, Motion=Z_6)  # -> Geometry, Transform
geo_4 = Geometry(flatten([srf_4, boundary]))
move_5 = Move(Geometry=item, Motion=Z_7)  # -> Geometry, Transform
# extraer piezas centrales
geo_5 = Geometry(trim)
srf_6 = Surface([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])
# punto medio habitacion
brec = BoundingRectangle(Geometry=geo_4, Plane=PlaneXY(0, 0, 0), Axis=0, Slide=0, Union=True)  # -> Bounding, DimensionX, DimensionY
cull_i = CullIndex(List=move_4.Geometry, Indices="-1", Wrap=True)
item_2 = ListItem(List=move_4.Geometry, Index="-1", Wrap=True)
Z_8 = UnitZ(Factor=Slider(236, range=0..10000))
splitmul_2 = SplitBrepMultiple(Brep=geo_5, Cutters=srf_6)  # -> flatten(Result)
number_slider_2 = Slider(20, range=0..100)
debrep = DeconstructBrep(Brep=brec.Bounding)  # -> Faces, Edges, Vertices
srf_7 = Surface(clscrv.Closed)
move_6 = Move(Geometry=item_2, Motion=Z_8)  # -> Geometry, Transform
panel_6 = Panel("""17
20""")
item_3 = ListItem(List=debrep.Edges, Index="0", Wrap=True)
geo_6 = Geometry(flatten([cull_i, move_5.Geometry, move_6.Geometry]))
cull_i_2 = CullIndex(List=splitmul_2, Indices=panel_6, Wrap=True)
item_4 = ListItem(List=splitmul_2, Index=panel_6, Wrap=True)
midpt = CurveMiddle(Curve=item_3)
pdecon_5 = Deconstruct(Point=midpt)  # -> XComponent, flatten(YComponent), ZComponent
# sustracciones baldas
brep = Brep([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])
# piezas centrales. division por paneles
srf_8 = Surface(item_4)
divisores_de_plancha_baldas_2 = Surface(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)
splitmul_3 = SplitBrepMultiple(Brep=srf_8, Cutters=divisores_de_plancha_baldas_2)  # -> simplify(Result)
# piezas centrales. separar por paredes
geo_7 = Geometry(flatten(splitmul_3))
# montantes. separar por paredes
geo_8 = Geometry(flatten(cull_i_2))
# peines. separar por paredes
geo_9 = Geometry(flatten(extr_3))
area_2 = Area(Geometry=geo_7)  # -> Area, Centroid
area_3 = Area(Geometry=geo_8)  # -> Area, Centroid
area_4 = Area(Geometry=geo_9)  # -> Area, Centroid
pdecon_6 = Deconstruct(Point=area_2.Centroid)  # -> XComponent, YComponent, ZComponent
pdecon_7 = Deconstruct(Point=area_3.Centroid)  # -> XComponent, YComponent, ZComponent
pdecon_8 = Deconstruct(Point=area_4.Centroid)  # -> XComponent, YComponent, ZComponent
eval_2 = Evaluate(F="if(x<y,1,0)", x=pdecon_6.XComponent, y=pdecon_5.XComponent)  # -> simplify(flatten(r))
eval_3 = Evaluate(F="if(x<y,1,0)", x=pdecon_7.XComponent, y=pdecon_5.XComponent)  # -> simplify(flatten(r))
eval_4 = Evaluate(F="if(x<y,1,0)", x=pdecon_8.XComponent, y=pdecon_5.XComponent)  # -> simplify(flatten(r))
dispatch_2 = Dispatch(List=geo_7, DispatchPattern=eval_2)  # -> ListA, ListB
dispatch_3 = Dispatch(List=geo_8, DispatchPattern=eval_3)  # -> ListA, ListB
dispatch_4 = Dispatch(List=geo_9, DispatchPattern=eval_4)  # -> ListA, ListB
geo_10 = Geometry()

# ----
# espesor tablas
number_slider_3 = Slider(16.5, range=0..100)

# ----
# mover divisiones para
# que caiga en mitad
# de un montante
Y_2 = UnitY(Factor=expr("x/2", number_slider_3))
move_7 = Move(Geometry=geo_6, Motion=Y_2)  # -> Geometry, Transform
splitmul_4 = SplitBrepMultiple(Brep=flatten([splitmul, srf_7]), Cutters=move_7.Geometry)  # -> simplify(graft(Result))
srf_9 = Surface(splitmul_4)
trim_2 = TrimSolid(Shape=srf_9, Cutters=brep)
# baldas
geo_11 = Geometry(flatten(trim_2))
area_5 = Area(Geometry=geo_11)  # -> Area, Centroid
pdecon_9 = Deconstruct(Point=area_5.Centroid)  # -> XComponent, YComponent, ZComponent
eval_5 = Evaluate(F="if(x<y,1,0)", x=pdecon_9.XComponent, y=pdecon_5.XComponent)  # -> simplify(flatten(r))
dispatch_5 = Dispatch(List=geo_11, DispatchPattern=eval_5)  # -> ListA, ListB

# ----
# Recopilatorio de geometrías
# baldas pared 1
# baldas pared 2
# montantes pared 1
# montantes pared 2
# peines pared 1
# peines pared 2
geo_12 = Geometry(dispatch_5.ListA)
geo_13 = Geometry(dispatch_4.ListA)
geo_14 = Geometry(dispatch_5.ListB)
geo_15 = Geometry(dispatch_3.ListA)
geo_16 = Geometry(dispatch_3.ListB)
geo_17 = Geometry(dispatch_4.ListB)

# ----
# Visualizar baldas
# Visualizar montantes
# Visualizar peines
number_slider_4 = Slider(76, range=0..255)
rgb_2 = ColourRGB(Alpha=255, Red=Slider(64, range=0..255), Green=number_slider_4, Blue=Slider(99, range=0..255))
rgb_3 = ColourRGB(Alpha=255, Red=Slider(64, range=0..255), Green=Slider(128, range=0..255), Blue=Slider(134, range=0..255))
rgb_4 = ColourRGB(Alpha=255, Red=Slider(64, range=0..255), Green=Slider(128, range=0..255), Blue=Slider(134, range=0..255))
preview_2 = CustomPreview(Geometry=[geo_12, geo_14], Material=rgb_2)
preview_3 = CustomPreview(Geometry=[geo_16, geo_15], Material=rgb_3)
preview_4 = CustomPreview(Geometry=[geo_16, geo_15], Material=rgb_4)

number_slider_5 = Slider(10, range=0..10)
geo_18 = Geometry(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)
Z_9 = UnitZ(Factor=expr("-x", number_slider_5))
num_6 = Number(altura_primera_balda)
move_8 = Move(Geometry=geo_18, Motion=Z_9)  # -> Geometry, Transform
subtraction_2 = Subtraction(A=num_6, B=number_slider_3)
addition_2 = Addition(A=num_6, B=number_slider_5)

# ----
# Perforar peines para ahorrar madera (en desuso)
# generar huecos en peines 1
# generar huecos en peines 2
splitmul_5 = SplitBrepMultiple(Brep=geo_17, Cutters=geo_16)  # -> simplify(Result)
splitmul_6 = SplitBrepMultiple(Brep=geo_13, Cutters=geo_15)  # -> simplify(Result)
debrep_2 = DeconstructBrep(Brep=splitmul_5)  # -> Faces, Edges, Vertices
debrep_3 = DeconstructBrep(Brep=splitmul_6)  # -> Faces, Edges, Vertices
join_3 = JoinCurves(Curves=debrep_2.Edges, Preserve=False)  # -> flatten(Curves)
join_4 = JoinCurves(Curves=debrep_3.Edges, Preserve=False)  # -> flatten(Curves)
area_6 = Area(Geometry=join_3)  # -> Area, Centroid
area_7 = Area(Geometry=join_4)  # -> Area, Centroid
number_slider_6 = Slider(4, range=0..10)
scale = Scale(Geometry=join_3, Center=area_6.Centroid, Factor=Slider(0.6, range=0..1))  # -> Geometry, Transform
number_slider_7 = Slider(24, range=0..100)
scale_2 = Scale(Geometry=join_4, Center=area_7.Centroid, Factor=Slider(0.6, range=0..1))  # -> Geometry, Transform
reb = RebuildCurve(Curve=scale.Geometry, Degree=number_slider_6, Count=number_slider_7, Tangents=False)
reb_2 = RebuildCurve(Curve=scale_2.Geometry, Degree=number_slider_6, Count=number_slider_7, Tangents=False)
sdiff_4 = SolidDifference(BrepsA=geo_17, BrepsB=reb)
sdiff_5 = SolidDifference(BrepsA=geo_13, BrepsB=reb_2)

Z_10 = UnitZ(Factor=addition_2)
srf_10 = Surface(move_8.Geometry)
extr_6 = Extrude(Base=srf_10, Direction=Z_10)
# PARED 2: añadir escalon a montantes para soportar bancada
debrep_4 = DeconstructBrep(Brep=geo_16)  # -> Faces, Edges, Vertices
# PARED 1: añadir escalon a montantes para soportar bancada
debrep_5 = DeconstructBrep(Brep=geo_15)  # -> Faces, Edges, Vertices
join_5 = JoinCurves(Curves=debrep_4.Edges, Preserve=False)  # -> simplify(Curves)
join_6 = JoinCurves(Curves=debrep_5.Edges, Preserve=False)  # -> simplify(Curves)
trim_3 = TrimWithBrep(Curve=join_5, Brep=extr_6)  # -> simplify(Inside), Outside
trim_4 = TrimWithBrep(Curve=join_6, Brep=extr_6)  # -> simplify(Inside), Outside
crv_9 = Curve(trim_3.Inside)
crv_10 = Curve(trim_4.Inside)
clscrv_2 = CloseCurve(Curve=crv_9, CloseType=0, Bulge=0.5, Tolerance=0)  # -> Closed, R
X_3 = UnitX(Factor=expr("-x", Slider(230, range=0..1000)))
clscrv_3 = CloseCurve(Curve=crv_10, CloseType=0, Bulge=0.5, Tolerance=0)  # -> Closed, R
X_4 = UnitX(Factor=Slider(230, range=0..1000))
move_9 = Move(Geometry=clscrv_2.Closed, Motion=X_3)  # -> Geometry, Transform
move_10 = Move(Geometry=clscrv_3.Closed, Motion=X_4)  # -> Geometry, Transform
srf_11 = Surface(move_9.Geometry)
srf_12 = Surface(join_5)
srf_13 = Surface(move_10.Geometry)
srf_14 = Surface(join_6)
# peines1. division por paneles
srf_15 = Surface(geo_13)
divisores_de_plancha_baldas_3 = Surface([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])
sunion_2 = SolidUnion(Breps=[srf_12, srf_11])
sunion_3 = SolidUnion(Breps=[srf_14, srf_13])
# peines2. division por paneles
srf_16 = Surface(geo_17)
divisores_de_plancha_baldas_4 = Surface([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])
edges = BrepEdges(Brep=sunion_2)  # -> Naked, Interior, NonManifold
splitmul_7 = SplitBrepMultiple(Brep=srf_15, Cutters=divisores_de_plancha_baldas_3)  # -> simplify(graft(Result))
edges_2 = BrepEdges(Brep=sunion_3)  # -> Naked, Interior, NonManifold
splitmul_8 = SplitBrepMultiple(Brep=srf_16, Cutters=divisores_de_plancha_baldas_4)  # -> simplify(graft(Result))
join_7 = JoinCurves(Curves=edges.Naked, Preserve=False)
join_8 = JoinCurves(Curves=edges_2.Naked, Preserve=False)
srf_17 = Surface(join_7)
srf_18 = Surface(join_8)

# ----
# Escalado previo a la exportación de los planos de corte
# para hacer maquetas/versión escala real
# baldas pared 1
# baldas pared 2
# montantes pared 1
# montantes pared 2
# peines pared 1
# peines pared 2
# piezas centrales pared a
# piezas centrales pared b
geo_19 = Geometry(flatten(splitmul_8))
# peines pared 1
# peines pared 2
geo_20 = Geometry(flatten(splitmul_7))
# baldas pared 1
# baldas pared 2
geo_21 = Geometry(geo_12)
# montantes pared 1
geo_22 = Geometry(geo_14)
# montantes pared 2
geo_23 = Geometry(srf_18)
geo_24 = Geometry(srf_17)
# factor de escala
panel_7 = Panel("1")
scale_3 = Scale(Geometry=geo_21, Center="0,0,0", Factor=panel_7)  # -> Geometry, Transform
scale_4 = Scale(Geometry=geo_22, Center="0,0,0", Factor=panel_7)  # -> Geometry, Transform
scale_5 = Scale(Geometry=geo_23, Center="0,0,0", Factor=panel_7)  # -> Geometry, Transform
scale_6 = Scale(Geometry=geo_24, Center="0,0,0", Factor=panel_7)  # -> Geometry, Transform
scale_7 = Scale(Geometry=geo_20, Center="0,0,0", Factor=panel_7)  # -> Geometry, Transform
scale_8 = Scale(Geometry=geo_19, Center="0,0,0", Factor=panel_7)  # -> Geometry, Transform
geo_25 = Geometry(scale_6.Geometry)
geo_26 = Geometry(flatten(scale_8.Geometry))
geo_27 = Geometry(flatten(scale_7.Geometry))
geo_28 = Geometry(scale_3.Geometry)
geo_29 = Geometry(scale_4.Geometry)
geo_30 = Geometry(scale_5.Geometry)
srf_19 = Surface(geo_7)
srf_20 = Surface(dispatch_2.ListB)

# ----
# Visualizar a escala
number_slider_8 = Slider(122, range=0..255)
rgb_5 = ColourRGB(Alpha=255, Red=number_slider_8, Green=Slider(104, range=0..255), Blue=Slider(115, range=0..255))
rgb_6 = ColourRGB(Alpha=255, Red=Slider(123, range=0..255), Green=Slider(38, range=0..255), Blue=Slider(178, range=0..255))
preview_5 = CustomPreview(Geometry=[geo_28, geo_29, geo_27, geo_26], Material=rgb_5)  # disabled
preview_6 = CustomPreview(Geometry=[geo_30, geo_25, srf_19, srf_20], Material=rgb_6)  # disabled

# ----
# ALARGAR MACLA
number_slider_9 = Slider(2, range=0..10)

# ----
# Generar muescas de maclaje
num_7 = Number(number_slider_3)
maclador_xy = MacladorXy(
    verticales=geo_25,
    espesor_panel=num_7,
    horizontales=geo_29,
    rotate_90º_boolean=Toggle(True),
    invertir_macla_boolean=Toggle(True),
    alargar_macla=number_slider_9)  # -> verticales_out, horizontales_out
maclador_xy_2 = MacladorXy(
    verticales=geo_30,
    espesor_panel=num_7,
    horizontales=geo_28,
    rotate_90º_boolean=Toggle(True),
    invertir_macla_boolean=Toggle(False),
    alargar_macla=number_slider_9)  # -> verticales_out, horizontales_out
maclador_verticales_peines = MacladorVerticalesPeines(
    verticales=maclador_xy.verticales_out,
    espesor_panel=num_7,
    horizontales=geo_26,
    rotate_90º_boolean=Toggle(True),
    invertir_macla_boolean=Toggle(False),
    alargar_macla=number_slider_9)  # -> verticales_out, horizontales_out
maclador_verticales_peines_2 = MacladorVerticalesPeines(
    verticales=maclador_xy_2.verticales_out,
    espesor_panel=num_7,
    horizontales=geo_27,
    rotate_90º_boolean=Toggle(True),
    invertir_macla_boolean=Toggle(False),
    alargar_macla=number_slider_9)  # -> verticales_out, horizontales_out
maclador_xy_3 = MacladorXy(
    verticales=srf_20,
    espesor_panel=num_7,
    horizontales=maclador_xy.horizontales_out,
    rotate_90º_boolean=Toggle(True),
    invertir_macla_boolean=Toggle(False),
    alargar_macla=number_slider_9)  # -> verticales_out, horizontales_out
geo_31 = Geometry(maclador_verticales_peines.horizontales_out)
geo_32 = Geometry(maclador_verticales_peines_2.horizontales_out)
geo_33 = Geometry(maclador_xy_2.horizontales_out)
geo_34 = Geometry(maclador_verticales_peines.verticales_out)
geo_35 = Geometry(maclador_verticales_peines_2.verticales_out)
geo_36 = Geometry(maclador_xy_3.verticales_out)
geo_37 = Geometry(maclador_xy_3.horizontales_out)

geo_38 = Geometry([geo_33, geo_35, geo_32, geo_37, geo_34, geo_31, geo_36])
number_slider_10 = Slider(50, range=0..100)
# MODULO A
geo_39 = Geometry([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])
# MODULO B
geo_40 = Geometry([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])
# MODULO C
geo_41 = Geometry([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])
# MODULO E
geo_42 = Geometry([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])
# MODULO D
geo_43 = Geometry([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])
# MODULO F
geo_44 = Geometry([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])
# MODULO G
geo_45 = Geometry([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])
geo_46 = Geometry([geo_39, geo_40, geo_41, geo_43, geo_42, geo_44, geo_45])
panel_8 = Panel("\ta.")  # disabled
panel_9 = Panel("c.")  # disabled
panel_10 = Panel("b.")  # disabled
panel_11 = Panel("d.")  # disabled
panel_12 = Panel("e.")  # disabled
panel_13 = Panel("f.")  # disabled
panel_14 = Panel("g.")  # disabled
number_slider_11 = Slider(21, range=0..100)  # disabled
con_perforaciones = ConPerforaciones(closed_curves=geo_39, tag_prefix=panel_8, text_size=number_slider_10)  # -> oriented, tags; disabled
con_perforaciones_2 = ConPerforaciones(closed_curves=geo_40, tag_prefix=panel_10, text_size=number_slider_10)  # -> oriented, tags; disabled
con_perforaciones_3 = ConPerforaciones(closed_curves=geo_41, tag_prefix=panel_9, text_size=number_slider_10)  # -> oriented, tags; disabled
con_perforaciones_4 = ConPerforaciones(closed_curves=geo_43, tag_prefix=panel_11, text_size=number_slider_10)  # -> oriented, tags; disabled
con_perforaciones_5 = ConPerforaciones(closed_curves=geo_42, tag_prefix=panel_12, text_size=number_slider_10)  # -> oriented, tags; disabled
con_perforaciones_6 = ConPerforaciones(closed_curves=geo_44, tag_prefix=panel_13, text_size=number_slider_10)  # -> oriented, tags; disabled
con_perforaciones_7 = ConPerforaciones(closed_curves=geo_45, tag_prefix=panel_14, text_size=number_slider_10)  # -> oriented, tags; disabled
number_slider_12 = Slider(3, range=0..10)  # disabled
number_slider_13 = Slider(7, range=0..10)  # disabled
number_slider_14 = Slider(20, range=0..100)  # disabled
geo_47 = Geometry()  # disabled
# baldas superiores
# piezas centrales
geo_48 = Geometry()  # disabled
# baldas pared 1
# baldas pared 2
geo_49 = Geometry(geo_33)  # disabled
# Exportar planos corte
item_5 = ListItem(List=geo_49, Index=number_slider_11, Wrap=True)  # disabled
cls = Closed(Curve=geo_49)  # -> Closed, Periodic; disabled
panel_15 = Panel(cls.Closed)  # disabled
# montantes pared 1
geo_50 = Geometry(geo_37)  # disabled
# montantes pared 2
geo_51 = Geometry(geo_35)  # disabled
# peines pared 1
geo_52 = Geometry(geo_34)  # disabled
# peines pared 2
geo_53 = Geometry(geo_32)  # disabled
geo_54 = Geometry(geo_31)  # disabled
crv_11 = Curve(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)  # disabled
opennest = OpenNest(
    Sheets=crv_11,
    Geo=con_perforaciones.oriented,
    Spacing=number_slider_14,
    Placement=1,
    Tolerance=number_slider_12,
    Rotations=4,
    Iterations=number_slider_13,
    Seed=1,
    Reset=True,
    Run=False)  # -> Sheets, Geo, ID, simplify(graft(Transform)), IDS; disabled
panel_16 = Panel("c.c.")  # disabled
panel_17 = Panel("c.s.")  # disabled
# ORIENTADAS + TEXT TAG
panel_18 = Panel("c.a.h.")  # disabled
panel_19 = Panel("c.b.h.")  # disabled
panel_20 = Panel("c.a.v.")  # disabled
panel_21 = Panel("c.b.v.")  # disabled
panel_22 = Panel("c.a.p")  # disabled
panel_23 = Panel("c.b.p")  # disabled
con_perforaciones_8 = ConPerforaciones(closed_curves=geo_53, tag_prefix=panel_22, text_size=number_slider_10)  # -> oriented, tags; disabled
transform = Transform(Geometry=con_perforaciones.tags, Transform=opennest.Transform)  # disabled
con_perforaciones_9 = ConPerforaciones(closed_curves=geo_47, tag_prefix=panel_16, text_size=number_slider_10)  # -> oriented, tags; disabled
con_perforaciones_10 = ConPerforaciones(closed_curves=geo_48, tag_prefix=panel_17, text_size=number_slider_10)  # -> oriented, tags; disabled
cluster = Cluster(closed_curves=geo_49, tag_prefix=panel_18, text_size=number_slider_10)  # -> oriented, tags; disabled
cluster_2 = Cluster(closed_curves=geo_50, tag_prefix=panel_19, text_size=number_slider_10)  # -> oriented, tags; disabled
cluster_3 = Cluster(closed_curves=geo_51, tag_prefix=panel_20, text_size=number_slider_10)  # -> oriented, tags; disabled
cluster_4 = Cluster(closed_curves=geo_52, tag_prefix=panel_21, text_size=number_slider_10)  # -> oriented, tags; disabled
con_perforaciones_11 = ConPerforaciones(closed_curves=geo_54, tag_prefix=panel_23, text_size=number_slider_10)  # -> oriented, tags; disabled
geometry = Geometry(opennest.Sheets)  # disabled
geometry_2 = Geometry(opennest.Geo)  # disabled
item_6 = ListItem(List=geo_45, Index=Slider(8, range=0..8), Wrap=False)
merge = Merge(
    Data1=con_perforaciones_2.oriented,
    Data2=con_perforaciones_3.oriented,
    Data3=con_perforaciones_4.oriented,
    Data4=con_perforaciones_5.oriented,
    Data5=con_perforaciones_6.oriented,
    Data6=con_perforaciones_7.oriented)  # disabled
stack = StackTrees(
    Data0=con_perforaciones_2.tags,
    Data1=con_perforaciones_3.tags,
    Data2=con_perforaciones_4.tags,
    Data3=con_perforaciones_5.tags,
    Data4=con_perforaciones_6.tags,
    Data5=con_perforaciones_7.tags,
    Reduce=True)  # disabled
number_slider_15 = Slider(6000, range=0..10000)  # disabled
number_slider_16 = Slider(9000, range=0..10000)  # disabled
number_slider_17 = Slider(12000, range=0..100000)  # disabled
number_slider_18 = Slider(18000, range=0..100000)  # disabled
number_slider_19 = Slider(21000, range=0..100000)  # disabled
number_slider_20 = Slider(24000, range=0..100000)  # disabled
number_slider_21 = Slider(3000, range=0..10000)  # disabled
number_slider_22 = Slider(15000, range=0..100000)  # disabled
number_slider_23 = Slider(9000, range=0..10000)  # disabled
number_slider_24 = Slider(18000, range=0..100000)  # disabled
number_slider_25 = Slider(24000, range=0..100000)  # disabled
number_slider_26 = Slider(3000, range=0..10000)  # disabled
number_slider_27 = Slider(6000, range=0..10000)  # disabled
number_slider_28 = Slider(12000, range=0..100000)  # disabled
number_slider_29 = Slider(15000, range=0..100000)  # disabled
number_slider_30 = Slider(21000, range=0..100000)  # disabled
srf_21 = Surface(item_6)
rgb_7 = ColourRGB(Alpha=255, Red=Slider(78, range=0..255), Green=Slider(93, range=0..255), Blue=Slider(128, range=0..255))
number_slider_31 = Slider(3, range=0..10)  # disabled
number_slider_32 = Slider(10, range=0..10)  # disabled
number_slider_33 = Slider(20, range=0..100)  # disabled
Y_3 = UnitY(Factor=number_slider_21)  # disabled
Y_4 = UnitY(Factor=number_slider_15)  # disabled
Y_5 = UnitY(Factor=number_slider_16)  # disabled
Y_6 = UnitY(Factor=number_slider_17)  # disabled
Y_7 = UnitY(Factor=number_slider_22)  # disabled
Y_8 = UnitY(Factor=number_slider_18)  # disabled
Y_9 = UnitY(Factor=number_slider_19)  # disabled
Y_10 = UnitY(Factor=number_slider_20)  # disabled
Y_11 = UnitY(Factor=number_slider_26)  # disabled
Y_12 = UnitY(Factor=number_slider_27)  # disabled
Y_13 = UnitY(Factor=number_slider_23)  # disabled
Y_14 = UnitY(Factor=number_slider_28)  # disabled
Y_15 = UnitY(Factor=number_slider_29)  # disabled
Y_16 = UnitY(Factor=number_slider_24)  # disabled
Y_17 = UnitY(Factor=number_slider_30)  # disabled
Y_18 = UnitY(Factor=number_slider_25)  # disabled
crv_12 = Curve(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)  # disabled
move_11 = Move(Geometry=cluster.oriented, Motion=Y_3)  # -> Geometry, Transform; disabled
move_12 = Move(Geometry=cluster_2.oriented, Motion=Y_4)  # -> Geometry, Transform; disabled
move_13 = Move(Geometry=cluster_3.oriented, Motion=Y_5)  # -> Geometry, Transform; disabled
move_14 = Move(Geometry=cluster_4.oriented, Motion=Y_6)  # -> Geometry, Transform; disabled
move_15 = Move(Geometry=con_perforaciones_8.oriented, Motion=Y_7)  # -> Geometry, Transform; disabled
move_16 = Move(Geometry=con_perforaciones_11.oriented, Motion=Y_8)  # -> Geometry, Transform; disabled
move_17 = Move(Motion=Y_9)  # -> Geometry, Transform; disabled
move_18 = Move(Motion=Y_10)  # -> Geometry, Transform; disabled
move_19 = Move(Geometry=cluster.tags, Motion=Y_11)  # -> Geometry, Transform; disabled
move_20 = Move(Geometry=cluster_2.tags, Motion=Y_12)  # -> Geometry, Transform; disabled
move_21 = Move(Geometry=cluster_3.tags, Motion=Y_13)  # -> Geometry, Transform; disabled
move_22 = Move(Geometry=cluster_4.tags, Motion=Y_14)  # -> Geometry, Transform; disabled
move_23 = Move(Geometry=con_perforaciones_8.tags, Motion=Y_15)  # -> Geometry, Transform; disabled
move_24 = Move(Geometry=con_perforaciones_11.tags, Motion=Y_16)  # -> Geometry, Transform; disabled
move_25 = Move(Motion=Y_17)  # -> Geometry, Transform; disabled
move_26 = Move(Motion=Y_18)  # -> Geometry, Transform; disabled
opennest_2 = OpenNest(
    Sheets=crv_12,
    Geo=merge,
    Spacing=number_slider_33,
    Placement=1,
    Tolerance=number_slider_31,
    Rotations=4,
    Iterations=number_slider_32,
    Seed=1,
    Reset=True,
    Run=False)  # -> Sheets, Geo, ID, simplify(graft(Transform)), IDS; disabled
stack_2 = StackTrees(Data0=geo_49, Data1=geo_50, Data2=geo_51, Data3=geo_52, Data4=geo_53, Data5=geo_54, Reduce=True)  # disabled
preview_7 = CustomPreview(Geometry=[item_6, stack_2, srf_21], Material=rgb_7)  # disabled
merge_2 = Merge(
    Data1=cluster.oriented,
    Data2=cluster_2.oriented,
    Data3=cluster_3.oriented,
    Data4=cluster_4.oriented,
    Data5=con_perforaciones_8.oriented,
    Data6=con_perforaciones_11.oriented,
    Data7=con_perforaciones_10.oriented,
    Data8=con_perforaciones_9.oriented)  # disabled
stack_3 = StackTrees(
    Data0=cluster.tags,
    Data1=cluster_2.tags,
    Data2=cluster_3.tags,
    Data3=cluster_4.tags,
    Data4=con_perforaciones_8.tags,
    Data5=con_perforaciones_11.tags,
    Data6=con_perforaciones_10.tags,
    Data7=con_perforaciones_9.tags,
    Reduce=True)  # disabled
crv_13 = Curve(opennest_2.Sheets)  # disabled
geometry_3 = Geometry(opennest_2.Geo)  # disabled
transform_2 = Transform(Geometry=stack, Transform=opennest_2.Transform)  # disabled
geo_55 = Geometry([con_perforaciones_8.oriented, con_perforaciones_8.tags])  # disabled
panel_24 = Panel(stack_2)  # disabled
number_slider_34 = Slider(3, range=0..10)  # disabled
number_slider_35 = Slider(2, range=0..10)  # disabled
number_slider_36 = Slider(20, range=0..100)  # disabled
crv_14 = Curve(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)  # disabled
opennest_3 = OpenNest(
    Sheets=crv_14,
    Geo=merge_2,
    Spacing=number_slider_36,
    Placement=1,
    Tolerance=number_slider_34,
    Rotations=4,
    Iterations=number_slider_35,
    Seed=1,
    Reset=True,
    Run=False)  # -> Sheets, Geo, ID, simplify(graft(Transform)), IDS; disabled
geometry_4 = Geometry(opennest_3.Sheets)  # disabled
transform_3 = Transform(Geometry=stack_3, Transform=opennest_3.Transform)  # disabled
geometry_5 = Geometry(opennest_3.Geo)  # disabled
panel_25 = Panel(geometry_4)  # disabled

# ==== cluster Cluster
closed_curves = ClusterInput()
crv = Curve(flatten(closed_curves))
boundary = BoundarySurfaces(Edges=crv)
area = Area(Geometry=boundary)  # -> Area, Centroid
evalsrf = EvaluateSurface(Surface=crv, Point=area.Centroid)  # -> Point, Normal, UDirection, VDirection, Frame
pt = Point(Point(0, 0, 0))
orient = OrientDirection(Geometry=crv, PointA=evalsrf.Point, DirectionA=evalsrf.Normal, PointB=pt, DirectionB="0,0,1")  # -> Geometry, Transform
geo = Geometry(orient.Geometry)
boundary_2 = BoundarySurfaces(Edges=geo)
area_2 = Area(Geometry=boundary_2)  # -> Area, Centroid
vec2pt = Vector2Pt(PointA=area_2.Centroid, PointB="0,0,0", Unitize=False)  # -> Vector, Length
move = Move(Geometry=geo, Motion=vec2pt.Vector)  # -> Geometry, Transform
xy = XYPlane(Origin=Point(0, 0, 0))
lng = ListLength(List=move.Geometry)
text_size = ClusterInput()
tag_prefix = ClusterInput()
dup = DuplicateData(Data=xy, Number=lng, Order=True)
pack = PackObjects(Geo=move.Geometry, Plane=dup, X=1, Y=1, Tolerabce=0)  # -> Geo, Transformation
divlength = DivideLength(Curve=pack.Geo, Length=Slider(0.3, range=0..10))  # -> Points, Tangents, Parameters
txt = Text(tag_prefix)
pline = PolyLine(Vertices=divlength.Points, Closed="True")
list_length = ListLength(List=pack.Geo)
inscribecircle = InscribeCircle(Polylines=pline, Tolerance=10)  # -> flatten(Circle)
series = Series(Start=0, Step=1, Count=list_length)
oriented = ClusterOutput(pack.Geo)
area_3 = Area(Geometry=inscribecircle)  # -> Area, Centroid
concatenate = Concatenate(FragmentA=txt, FragmentB=series)  # -> flatten(Result)
text = Text(Location=area_3.Centroid, Text=concatenate, Size=text_size, Font="MecSoft_Font-1")  # -> simplify(Curves)
brec = BoundingRectangle(Geometry=text, Plane=PlaneXY(0, 0, 0), Axis=0, Slide=0, Union=True)  # -> Bounding, DimensionX, DimensionY
area_4 = Area(Geometry=brec.Bounding)  # -> Area, Centroid
vec2pt_2 = Vector2Pt(PointA=area_4.Centroid, PointB=graft(area_3.Centroid), Unitize=False)  # -> simplify(Vector), Length
move_2 = Move(Geometry=text, Motion=vec2pt_2.Vector)  # -> Geometry, Transform
tags = ClusterOutput(move_2.Geometry)

# ==== cluster ConPerforaciones
closed_curves = ClusterInput()
crv = Curve(flatten(closed_curves))
srf = Surface(crv)
crv_2 = Curve(closed_curves)
boundary = BoundarySurfaces(Edges=crv)
cls = Closed(Curve=crv)  # -> Closed, Periodic
area = Area(Geometry=boundary)  # -> Area, Centroid
panel = Panel(cls.Closed)
evalsrf = EvaluateSurface(Surface=crv, Point=area.Centroid)  # -> Point, Normal, UDirection, VDirection, Frame
pt = Point(Point(0, 0, 0))
orient = OrientDirection(Geometry=crv, PointA=evalsrf.Point, DirectionA=evalsrf.Normal, PointB=pt, DirectionB="0,0,1")  # -> Geometry, Transform
geo = Geometry(orient.Geometry)
boundary_2 = BoundarySurfaces(Edges=geo)
panel_2 = Panel(area.Centroid)
area_2 = Area(Geometry=boundary_2)  # -> Area, Centroid
vec2pt = Vector2Pt(PointA=area_2.Centroid, PointB="0,0,0", Unitize=False)  # -> Vector, Length
move = Move(Geometry=geo, Motion=vec2pt.Vector)  # -> Geometry, Transform
xy = XYPlane(Origin=Point(0, 0, 0))
lng = ListLength(List=move.Geometry)
text_size = ClusterInput()
tag_prefix = ClusterInput()
dup = DuplicateData(Data=xy, Number=lng, Order=True)
txt = Text(tag_prefix)
pack = PackObjects(Geo=move.Geometry, Plane=dup, X=1, Y=1, Tolerabce=0)  # -> Geo, Transformation
divlength = DivideLength(Curve=pack.Geo, Length=Slider(0.3, range=0..10))  # -> Points, Tangents, Parameters
pline = PolyLine(Vertices=divlength.Points, Closed="True")
list_length = ListLength(List=pack.Geo)
inscribecircle = InscribeCircle(Polylines=pline, Tolerance=10)  # -> flatten(Circle)
series = Series(Start=0, Step=1, Count=list_length)
oriented = ClusterOutput(pack.Geo)
area_3 = Area(Geometry=inscribecircle)  # -> Area, Centroid
concatenate = Concatenate(FragmentA=txt, FragmentB=series)  # -> flatten(Result)
text = Text(Location=area_3.Centroid, Text=concatenate, Size=text_size, Font="MecSoft_Font-1")  # -> simplify(Curves)
brec = BoundingRectangle(Geometry=text, Plane=PlaneXY(0, 0, 0), Axis=0, Slide=0, Union=True)  # -> Bounding, DimensionX, DimensionY
area_4 = Area(Geometry=brec.Bounding)  # -> Area, Centroid
vec2pt_2 = Vector2Pt(PointA=area_4.Centroid, PointB=graft(area_3.Centroid), Unitize=False)  # -> simplify(Vector), Length
move_2 = Move(Geometry=text, Motion=vec2pt_2.Vector)  # -> Geometry, Transform
tags = ClusterOutput(move_2.Geometry)

# ==== cluster MacladorXy
espesor_panel = ClusterInput()
rotate_90º_boolean = ClusterInput()
invertir_macla_boolean = ClusterInput()
unit_x = UnitX(Factor=1)
multiplication = Multiplication(A=rotate_90º_boolean, B="90")
rad = Radians(Degrees=multiplication)
num = Number(espesor_panel)
vrot = Rotate(Vector=unit_x, Axis="0,0,1", Angle=rad)
amp = Amplitude(Vector=vrot, Amplitude=num)
verticales = ClusterInput()
horizontales = ClusterInput()
Z = UnitZ(Factor=1)
amp_2 = Amplitude(Vector=Z, Amplitude=num)
# horizontales
vec = Vector(amp)
# verticales
surface = Surface(verticales)
vec_2 = Vector(amp_2)
surface_2 = Surface(horizontales)
extrude = Extrude(Base=surface_2, Direction=vec_2)
extrude_2 = Extrude(Base=surface, Direction=vec)
cross_reference = CrossReference(ListListA=extrude_2, ListListB=extrude, CrossMode=1)  # -> ListListA, ListListB
brep_brep = BrepBrep(BrepA=cross_reference.ListListA, BrepB=cross_reference.ListListB)  # -> Curves, Points
bounding_box = BoundingBox(Content=brep_brep.Curves, Plane=PlaneXY(0, 0, 0), UnionBox=True)  # -> Box, Box_2
debox = DeconstructBox(Box=bounding_box.Box)  # -> Plane, X, Y, Z
num_2 = Number([debox.Y, debox.X, debox.Z])
sort = SortList(Keys=num_2)  # -> reverse(Keys), ValuesA
item = ListItem(List=sort.Keys, Index=0, Wrap=True)
number = Number(item)
alargar_macla = ClusterInput()  # Establece los milimetros que quieres que se extienda la macla
division = Division(A=number, B=Slider(2, range=0..10))
subtraction = Subtraction(A=division, B=alargar_macla)
X = UnitX(Factor=1)
amp_3 = Amplitude(Vector=X, Amplitude=subtraction)
rad_2 = Radians(Degrees=expr("X*180", invertir_macla_boolean))
vrot_2 = Rotate(Vector=amp_3, Axis="0,0,1", Angle=rad_2)
move = Move(Geometry=bounding_box.Box, Motion=vrot_2)  # -> Geometry, Transform
move_2 = Move(Geometry=bounding_box.Box, Motion=expr("-x", vrot_2))  # -> Geometry, Transform
solid_difference = SolidDifference(BrepsA=flatten(extrude), BrepsB=flatten(move_2.Geometry))
solid_difference_2 = SolidDifference(BrepsA=flatten(extrude_2), BrepsB=flatten(move.Geometry))
deconstruct_brep = DeconstructBrep(Brep=solid_difference_2)  # -> Faces, Edges, Vertices
deconstruct_brep_2 = DeconstructBrep(Brep=solid_difference)  # -> Faces, Edges, Vertices
area = Area(Geometry=deconstruct_brep.Faces)  # -> Area, Centroid
area_2 = Area(Geometry=deconstruct_brep_2.Faces)  # -> Area, Centroid
sort_list = SortList(Keys=area.Area, ValuesValuesA=deconstruct_brep.Faces)  # -> Keys, reverse(ValuesValuesA)
sort_list_2 = SortList(Keys=area_2.Area, ValuesValuesA=deconstruct_brep_2.Faces)  # -> Keys, reverse(ValuesValuesA)
panel = Panel("""0
1""")
panel_2 = Panel("""0
1""")
list_item = ListItem(List=sort_list_2.ValuesValuesA, Index=panel, Wrap=True)  # -> simplify(Item)
# VOLVER A OBTENER LA CARA ORIGINAL
list_item_2 = ListItem(List=sort_list.ValuesValuesA, Index=panel_2, Wrap=True)  # -> simplify(Item)
area_3 = Area(Geometry=list_item)  # -> Area, Centroid
# VOLVER A OBTENER LA CARA ORIGINAL
area_4 = Area(Geometry=list_item_2)  # -> Area, Centroid
pdecon = Deconstruct(Point=area_3.Centroid)  # -> XComponent, YComponent, ZComponent
pdecon_2 = Deconstruct(Point=area_4.Centroid)  # -> XComponent, YComponent, ZComponent
sort_2 = SortList(Keys=pdecon_2.YComponent, ValuesA=list_item_2)  # -> Keys, ValuesA
sort_3 = SortList(Keys=pdecon.ZComponent, ValuesA=list_item)  # -> Keys, ValuesA
list_item_3 = ListItem(List=sort_2.ValuesA, Index="0", Wrap=True)  # -> simplify(Item)
list_item_4 = ListItem(List=sort_3.ValuesA, Index="0", Wrap=True)  # -> simplify(Item)
brep_edges = BrepEdges(Brep=list_item_3)  # -> Naked, Interior, NonManifold
brep_edges_2 = BrepEdges(Brep=list_item_4)  # -> Naked, Interior, NonManifold
join_curves = JoinCurves(Curves=brep_edges.Naked, Preserve=False)  # -> simplify(flatten(Curves))
join_curves_2 = JoinCurves(Curves=brep_edges_2.Naked, Preserve=False)  # -> simplify(flatten(Curves))
horizontales_out = ClusterOutput(join_curves_2)
verticales_out = ClusterOutput(join_curves)

# ==== cluster MacladorVerticalesPeines
espesor_panel = ClusterInput()
rotate_90º_boolean = ClusterInput()
invertir_macla_boolean = ClusterInput()
unit_x = UnitX(Factor=1)
multiplication = Multiplication(A=rotate_90º_boolean, B="90")
rad = Radians(Degrees=multiplication)
num = Number(espesor_panel)
Y = UnitY(Factor=1)
vrot = Rotate(Vector=unit_x, Axis="0,0,1", Angle=rad)
amp = Amplitude(Vector=vrot, Amplitude=num)
rad_2 = Radians(Degrees="90")
verticales = ClusterInput()
horizontales = ClusterInput()
vrot_2 = Rotate(Vector=amp, Axis="0,0,1", Angle=rad_2)
# horizontales
vec = Vector(amp)
# verticales
surface = Surface(verticales)
vec_2 = Vector(vrot_2)
surface_2 = Surface(horizontales)
extrude = Extrude(Base=surface_2, Direction=vec_2)
extrude_2 = Extrude(Base=surface, Direction=vec)
cross_reference = CrossReference(ListListA=extrude_2, ListListB=extrude, CrossMode=1)  # -> ListListA, ListListB
brep_brep = BrepBrep(BrepA=cross_reference.ListListA, BrepB=cross_reference.ListListB)  # -> Curves, Points
bounding_box = BoundingBox(Content=brep_brep.Curves, Plane=PlaneXY(0, 0, 0), UnionBox=True)  # -> Box, Box_2
debox = DeconstructBox(Box=bounding_box.Box)  # -> Plane, X, Y, Z
num_2 = Number([debox.Y, debox.X, debox.Z])
sort = SortList(Keys=num_2)  # -> reverse(Keys), ValuesA
item = ListItem(List=sort.Keys, Index=0, Wrap=True)
number = Number(item)
alargar_macla = ClusterInput()  # Establece los milimetros que quieres que se extienda la macla
division = Division(A=number, B=Slider(2, range=0..10))
subtraction = Subtraction(A=division, B=alargar_macla)
Z = UnitZ(Factor=1)
amp_2 = Amplitude(Vector=Z, Amplitude=subtraction)
rad_3 = Radians(Degrees=expr("X*180", Toggle(True)))
vrot_3 = Rotate(Vector=amp_2, Axis="1,0,0", Angle=rad_3)
move = Move(Geometry=bounding_box.Box, Motion=vrot_3)  # -> Geometry, Transform
move_2 = Move(Geometry=bounding_box.Box, Motion=expr("-x", vrot_3))  # -> Geometry, Transform
solid_difference = SolidDifference(BrepsA=flatten(extrude), BrepsB=flatten(move_2.Geometry))
solid_difference_2 = SolidDifference(BrepsA=flatten(extrude_2), BrepsB=flatten(move.Geometry))
deconstruct_brep = DeconstructBrep(Brep=solid_difference_2)  # -> Faces, Edges, Vertices
deconstruct_brep_2 = DeconstructBrep(Brep=solid_difference)  # -> Faces, Edges, Vertices
area = Area(Geometry=deconstruct_brep.Faces)  # -> Area, Centroid
area_2 = Area(Geometry=deconstruct_brep_2.Faces)  # -> Area, Centroid
sort_list = SortList(Keys=area.Area, ValuesValuesA=deconstruct_brep.Faces)  # -> Keys, reverse(ValuesValuesA)
sort_list_2 = SortList(Keys=area_2.Area, ValuesValuesA=deconstruct_brep_2.Faces)  # -> Keys, reverse(ValuesValuesA)
panel = Panel("""0
1""")
panel_2 = Panel("""0
1""")
list_item = ListItem(List=sort_list_2.ValuesValuesA, Index=panel, Wrap=True)  # -> simplify(Item)
# VOLVER A OBTENER LA CARA ORIGINAL
list_item_2 = ListItem(List=sort_list.ValuesValuesA, Index=panel_2, Wrap=True)  # -> simplify(Item)
area_3 = Area(Geometry=list_item)  # -> Area, Centroid
# VOLVER A OBTENER LA CARA ORIGINAL
area_4 = Area(Geometry=list_item_2)  # -> Area, Centroid
pdecon = Deconstruct(Point=area_3.Centroid)  # -> XComponent, YComponent, ZComponent
pdecon_2 = Deconstruct(Point=area_4.Centroid)  # -> XComponent, YComponent, ZComponent
sort_2 = SortList(Keys=pdecon_2.YComponent, ValuesA=list_item_2)  # -> Keys, ValuesA
sort_3 = SortList(Keys=pdecon.XComponent, ValuesA=list_item)  # -> Keys, ValuesA
list_item_3 = ListItem(List=sort_2.ValuesA, Index="0", Wrap=True)  # -> simplify(Item)
list_item_4 = ListItem(List=sort_3.ValuesA, Index="0", Wrap=True)  # -> simplify(Item)
brep_edges = BrepEdges(Brep=list_item_3)  # -> Naked, Interior, NonManifold
brep_edges_2 = BrepEdges(Brep=list_item_4)  # -> Naked, Interior, NonManifold
join_curves = JoinCurves(Curves=brep_edges.Naked, Preserve=False)  # -> simplify(flatten(Curves))
join_curves_2 = JoinCurves(Curves=brep_edges_2.Naked, Preserve=False)  # -> simplify(flatten(Curves))
panel_3 = Panel(join_curves_2)
crv = Curve(join_curves_2)
verticales_out = ClusterOutput(join_curves)
horizontales_out = ClusterOutput(crv)
